# Grasshopper definition configurator.gh (Grasshopper 1.0.8)
# plug-ins: treesloth01

height = GetNumber(
    Slider(500, range=100..1000),
    AtLeast=1,
    AtMost=2147483647,
    Maximum=1.797693135e+308,
    Minimum=-1.797693135e+308,
    TreeAccess=False)
depth = GetNumber(
    Slider(300, range=200..700),
    AtLeast=1,
    AtMost=2147483647,
    Maximum=1.797693135e+308,
    Minimum=-1.797693135e+308,
    TreeAccess=False)

# ---- group: RH_IN:explode
bool = Boolean(invert(False))

# ----
width = GetNumber(
    Slider(1500, range=800..2000),
    AtLeast=1,
    AtMost=2147483647,
    Maximum=1.797693135e+308,
    Minimum=-1.797693135e+308,
    TreeAccess=False)
num = GetNumber(
    Slider(3, range=1..10),
    AtLeast=1,
    AtMost=2147483647,
    Maximum=1.797693135e+308,
    Minimum=-1.797693135e+308,
    TreeAccess=False)
num_2 = Number(height)
num_3 = Number(width)
num_4 = Number(depth)
int = Integer(num)

# ----
# Structure
panel = Panel("storage unit")
panel_2 = Panel("{0}")
panel_3 = Panel("""{0} - straight
{1} - L 
{2} - U""")
panel_4 = Panel("column / outer carcass")
# {x,0} - outer carcass
#  [0] - top
#  [1] - bottom
#  [2] - front
#  [3] - back
#  [4] - left
#  [5] - right
# 
# 
# 
# {x,1} - column
#  [0] - left most
#  [1] - beside that
#  [2] -
panel_5 = Panel("{x,0}")
panel_6 = Panel("""shelf/shelf size
shutter/hardware""")
panel_7 = Panel("{x,x,0}")
panel_8 = Panel("""0 - bottom most
1 - above that
2 - above""")
panel_9 = Panel("surface")
panel_10 = Panel("{0,0,0,0}")
panel_11 = Panel("""0 - top
1 - bottom
2 - front
3 - back
4 - left
5 - right""")
panel_12 = Panel("placement point")
panel_13 = Panel("{0,0,0,0,0}")
panel_14 = Panel("""F -> B
L -> R
B -> T

0 - LBF
1 - """)
panel_15 = Panel("x/ y/ z")
panel_16 = Panel("{0,0,0,0,0,0}")
panel_17 = Panel("""0 - X
1 - Y
2 - Z""")

xz = XZPlane(Origin=Point(0, 0, 0))
cir = Circle(Plane=xz, Radius="5")
Y = UnitY(Factor=expr("-x", "10"))
extr = Extrude(Base=cir, Direction=Y)
cir_2 = Circle(Plane=xz, Radius="15")
extr_2 = Extrude(Base=cir_2, Direction=Y)
move = Move(Geometry=extr_2, Motion=Y)  # -> Geometry, Transform
cap = CapHoles(Brep=[extr, move.Geometry])
sunion = SolidUnion(Breps=cap)

# ---- group: each shelve dims
length = ValueList({"600", "450"}, selected="450")

# ----
fascia = ShutterTypes({"Flushed": 0, "Flutted": 1, "Glass": 2, "Panelled": 3}, selected="Panelled")
shutter_type = Data(fascia)

leg = ValueList({"Skirting": 0, "Leg": 1, "Leg + Skiting": 2}, selected="Leg")
leg_type = Data(leg)

leg_height = ValueList({"100", "150", "200"}, selected="100")
leg_height_2 = Data(leg_height)

shelf_length = Data(length)
shelf_length_2 = Data(shelf_length)

# ---- group: Backend Parameter / handle geometry
knob_geo = Data(sunion)

# ---- group: Backend Parameter
# Preset Design settings
panel_18 = Panel(leg_height_2)
channel_clearance = Data("12")
bottom_clearance = Data("12")
skirting_height = Data(panel_18)
knob_handle = Data(knob_geo)

# ----
carcass_length = Data(num_3)
wall_length = Data(carcass_length)
division = Division(A=wall_length, B=shelf_length_2)
int_2 = Integer(division)
carcass_depth = Data(num_4)
carcass_height = Data(num_2)
number_of_col = Data(int_2)
duplicate_data = DuplicateData(Data="2", Number=number_of_col, Order=True)

# ----
# starting from left
board1_thickness = Slider(18, range=0..30)
placement = ValueList({"middle": 0, "side": 1}, selected="side")
list_of_row_num = Data(duplicate_data)

mid_side = Data(placement)
board_thickness = Data(board1_thickness)
datadam_trigger = CSharpScript(Data=carcass_length, Trigger=bool)  # -> out, OutData; inputs Data: tree, Trigger: Boolean
# ---------- datadam_trigger: C# ----------
    if(Trigger)
    {
      data = Data;
    }
    OutData = data;
# ---------- datadam_trigger: C# additional code ----------
  object data;
# ---------- end datadam_trigger ----------
panel_19 = Panel("""This compnent calculates the shelving positions and sizes. Outputs the 
- positions as datatree of Point3d 
- sizes as datatree of Vector3d, where the x,y,z are essesntially the L,W,H """)

carcass_length_2 = Data(carcass_length)
carcass_depth_2 = Data(carcass_depth)
carcass_height_2 = Data(carcass_height)
number_of_col_2 = Data(number_of_col)
board_thickness_2 = Data(board_thickness)
skirting_height_2 = Data(skirting_height)
list_of_row_num_2 = Data(flatten(list_of_row_num))
unit_placement = CSharpScript(
    description=panel_19,
    L=carcass_length_2,
    D=carcass_depth_2,
    H=carcass_height_2,
    num_col=number_of_col_2,
    board_thickness=board_thickness_2,
    skirting_height=skirting_height_2,
    list_of_row_num=list_of_row_num_2)  # -> out, placement, sizing; inputs L: Double, D: Double, H: Double, num_col: Double, board_thickness: Double, skirting_height: Double, list_of_row_num: list of Double
# ---------- unit_placement: C# ----------
    // Component written by Pallavi Ray
    // POST 105
    // August, 2023
    // V0.1
    Component.NickName = "unit_placement";
    Component.Description = "Calculates the placement of the unit bases for straight unit";


    //check if number of row is more than the list of shelves_each_row
    //if yes then add undivided units
    if(num_col > list_of_row_num.Count )
    { for (int i = list_of_row_num.Count - 1; i < num_col; i++)
      {
        list_of_row_num.Add(1);
      }
    }





    //Setup shelve details
    double shelve_length = (L - (2 * num_col * board_thickness)) / num_col;
    double shelve_depth = D - board_thickness;


    //Set up dataTree Placement
    DataTree < Point3d > _placement = new DataTree<Point3d>();

    for(int i = 0; i < num_col;i++)
    {
      double num_row = list_of_row_num[i];
      double shelve_height = (H - ((num_row) *board_thickness) - skirting_height ) / num_row;

      for (int j = 0; j < list_of_row_num[i];j++)
      {

        GH_Path pth_0 = new GH_Path(0, i, j);
        _placement.Add(new Point3d(( (shelve_length * i) + ( ((i * 2) + 1) * board_thickness ) ),
          0.0,
          ((shelve_height * j) + skirting_height + (j * board_thickness))),
          pth_0);
      }
    }




    //Set up dataTree Sizing
    DataTree<Vector3d> _sizing = new DataTree<Vector3d>();

    // double shelve_length = (L - ((num_col + 1) * board_thickness) ) / num_col;

    for(int i = 0; i < num_col;i++)
    {
      double num_row = list_of_row_num[i];
      double shelve_height = (H - ((num_row) *board_thickness) - skirting_height ) / num_row;

      for (int j = 0; j < list_of_row_num[i];j++)
      {

        GH_Path pth_0 = new GH_Path(0, i, j);

        //var shelve_height =
        Vector3d val = new Vector3d(shelve_length, shelve_depth, shelve_height);
        _sizing.Add(val, pth_0);
      }
    }


    placement = _placement;
    sizing = _sizing;
# ---------- end unit_placement ----------
shelves_placement_point3d = Data(unit_placement.placement)
shelves_sizing_vector3d = Data(unit_placement.sizing)

# ----
# Storage Unit : Column : Row
panel_20 = Panel("""Open
Drawer
Shutter""")
list_length = ListLength(List=panel_20)
shelves_placement = Data(shelves_placement_point3d)
tree_statistics = TreeStatistics(Tree=shelves_placement)  # -> Paths, Length, Count
random = Random(Range=list_length, Number=tree_statistics.Count, Seed=2, Integers=True)
copylisttotree = CSharpScript(to_match=shelves_placement, list=panel_20)  # -> out, A; inputs to_match: tree, list: list
# ---------- copylisttotree: C# ----------
    ///////////////////////////////DataTree///////////////////////////////
    //Set up tree
    DataTree<object> new_dt = new DataTree<object>();
    var p = to_match.Paths;

    for(int i = 0; i < p.Count;i++)
    {
     // GH_Path path = to_match. ;


      new_dt.AddRange(list, p[i]);


    }

    A = new_dt;
# ---------- end copylisttotree ----------
list_item = ListItem(List=panel_20, Index=random, Wrap=True)
tree_statistics_2 = TreeStatistics(Tree=graft(list_item))  # -> Paths, Length, Count
replace_paths = ReplacePaths(Data=graft(list_item), Search=tree_statistics_2.Paths, Replace=tree_statistics.Paths)

panel_21 = Panel(replace_paths)

# ---- group: Carcass base left corner
vec = VectorXYZ(XComponent="0", YComponent="0", ZComponent="0")  # -> Vector, Length
xy = XYPlane(Origin=vec.Vector)

# ----
shift_paths = ShiftPaths(Data=shelves_placement_point3d, Offset=-1)
bool_2 = Boolean(bool)
bool_3 = Boolean(bool)
bool_4 = Boolean(bool)
leg_type_2 = Data(leg_type)
leg_type_3 = Data(leg_type)
leg_type_4 = Data(leg_type)
num_5 = Number(leg_type_3)
num_6 = Number(leg_type_4)
num_7 = Number(leg_type_2)

# ----
# CARCASS
# This compnent generates the elements of the outer carcass as a data tree with path {0,0}[correspondind side numbmer].
# Depending on the leg type the geometry is decided
carcass_length_3 = Data(carcass_length)
carcass_height_3 = Data(carcass_height)
board_thickness_3 = Data(board_thickness)
pln = Plane(vec.Vector)
carcass_depth_3 = Data(carcass_depth)
skirting_height_3 = Data(skirting_height)
# This compnent generates the verticle columns as a data tree with path {0,1}[column number].
carcass_length_4 = Data(carcass_length)
carcass_depth_4 = Data(carcass_depth)
carcass_height_4 = Data(carcass_height)
board_thickness_4 = Data(board_thickness)
skirting_height_4 = Data(skirting_height)
shelves_placement_2 = Data(shift_paths)
# This compnent generates the SHELVES BASES as a data tree with path {x,x,column}[row].
carcass_length_5 = Data(datadam_trigger.OutData)
carcass_depth_5 = Data(carcass_depth)
carcass_height_5 = Data(carcass_height)
board_thickness_5 = Data(board_thickness)
skirting_height_5 = Data(skirting_height)
shelves_placement_3 = Data(shift_paths)
carcass_outer = CSharpScript(
    reset=bool_2,
    base=pln,
    L=carcass_length_3,
    D=carcass_depth_3,
    H=carcass_height_3,
    board_thickness=board_thickness_3,
    skirting_height=skirting_height_3,
    leg_type=num_5)  # -> out, outerCarcass; inputs reset: Boolean, base: Plane, L: Double, D: Double, H: Double, board_thickness: Double, skirting_height: Double, leg_type: Int32
# ---------- carcass_outer: C# ----------
    // Component written by Pallavi Ray
    // POST 105
    // August, 2023
    // V0.1
    Component.NickName = "Carcass_Outer";
    Component.Description = "Creates an outer carcass for straight unit";



    if(init)
    {
      init = false;
      bb.AddRange(update(L, D, H, board_thickness, skirting_height, leg_type), path);
    }

    if(reset)
    {
      bb.Clear();
      bb.AddRange(update(L, D, H, board_thickness, skirting_height, leg_type), path);
    }

    outerCarcass = bb;
# ---------- carcass_outer: C# additional code ----------
  public bool init = true;
  public DataTree<BoundingBox> bb = new DataTree<BoundingBox>();
  public GH_Path path = new GH_Path(0, 0);


  public List<BoundingBox>  update (double L, double D, double H, double board_thickness, double skirting_height, int leg_type)
  {

    List<BoundingBox> b = new List<BoundingBox > ();

    BoundingBox base_box = new BoundingBox(new Point3d(0, 0, 0), new Point3d(1, 1, 1));
    //Box base_box = new Box(Plane.WorldXY, new Interval(0, 1), new Interval(0, 1), new Interval(0, 1));

    List<Transform> scale_T = new List<Transform>();
    List<Transform> rotate_T = new List<Transform>();
    List<Transform> move_T = new List<Transform>();


    //Creating Planes
    var origin = Point3d.Origin;


    //0 - Top
    scale_T.Add((Transform.Scale(Plane.WorldXY, L, D, board_thickness)));
    rotate_T.Add(Transform.Rotation(0, Point3d.Origin));
    move_T.Add((Transform.Translation(0, 0, H - board_thickness)));


    if(leg_type == 0)
    {

      //1 - Bottom
      scale_T.Add((Transform.Scale(Plane.WorldXY, L - (2 * board_thickness), skirting_height, board_thickness)));
      rotate_T.Add(Transform.Rotation(Math.PI / 2, Vector3d.XAxis, Point3d.Origin));
      move_T.Add((Transform.Translation(board_thickness, 2 * board_thickness, 0)));

      //2 - Front
      scale_T.Add((Transform.Scale(Plane.WorldXY, L - (2 * board_thickness), skirting_height, board_thickness)));
      rotate_T.Add(Transform.Rotation(Math.PI / 2, Vector3d.XAxis, Point3d.Origin));
      move_T.Add((Transform.Translation(board_thickness, 2 * board_thickness, 0)));

      //3 - Back
      scale_T.Add((Transform.Scale(Plane.WorldXY, 0, 0, 0)));
      rotate_T.Add(Transform.Rotation(0, Vector3d.YAxis, Point3d.Origin));
      move_T.Add((Transform.Translation(0, 0, 0)));


      //4 - SideLeft
      scale_T.Add((Transform.Scale(Plane.WorldXY, H - board_thickness, D - board_thickness, board_thickness)));
      rotate_T.Add(Transform.Rotation(3 * Math.PI / 2, Vector3d.YAxis, Point3d.Origin));
      move_T.Add((Transform.Translation(board_thickness, board_thickness, 0)));

      //5 - SideRight
      scale_T.Add((Transform.Scale(Plane.WorldXY, -(H - board_thickness), D - board_thickness, board_thickness)));
      rotate_T.Add(Transform.Rotation(Math.PI / 2, Vector3d.YAxis, Point3d.Origin));
      move_T.Add((Transform.Translation(L - board_thickness, board_thickness, 0)));


    }

    if(leg_type == 1)
    {

      //1 - Bottom
      scale_T.Add((Transform.Scale(Plane.WorldXY, L - 2 * board_thickness, D - board_thickness, -board_thickness)));
      rotate_T.Add(Transform.Rotation(0, Point3d.Origin));
      move_T.Add((Transform.Translation(board_thickness, board_thickness, skirting_height)));


      //2 - Front //null
      scale_T.Add((Transform.Scale(Plane.WorldXY, 0, 0, 0)));
      rotate_T.Add(Transform.Rotation(0, Vector3d.YAxis, Point3d.Origin));
      move_T.Add((Transform.Translation(0, 0, 0)));


      //3 - Back //null
      scale_T.Add((Transform.Scale(Plane.WorldXY, 0, 0, 0)));
      rotate_T.Add(Transform.Rotation(0, Vector3d.YAxis, Point3d.Origin));
      move_T.Add((Transform.Translation(0, 0, 0)));

      //4 - SideLeft
      scale_T.Add((Transform.Scale(Plane.WorldXY, H - skirting_height, D - board_thickness, board_thickness)));
      rotate_T.Add(Transform.Rotation(3 * Math.PI / 2, Vector3d.YAxis, Point3d.Origin));
      move_T.Add((Transform.Translation(board_thickness, board_thickness, skirting_height - board_thickness)));

      //5 - SideRight
      scale_T.Add((Transform.Scale(Plane.WorldXY, -(H - skirting_height), D - board_thickness, board_thickness)));
      rotate_T.Add(Transform.Rotation(Math.PI / 2, Vector3d.YAxis, Point3d.Origin));
      move_T.Add((Transform.Translation(L - board_thickness, board_thickness, skirting_height - board_thickness)));

    }




    if(leg_type == 2)
    {

      //1 - Bottom
      scale_T.Add((Transform.Scale(Plane.WorldXY, L - 2 * board_thickness, D - board_thickness, -board_thickness)));
      rotate_T.Add(Transform.Rotation(0, Point3d.Origin));
      move_T.Add((Transform.Translation(board_thickness, board_thickness, skirting_height)));

      //2 - Front
      scale_T.Add((Transform.Scale(Plane.WorldXY, L - (2 * board_thickness), skirting_height, board_thickness)));
      rotate_T.Add(Transform.Rotation(Math.PI / 2, Vector3d.XAxis, Point3d.Origin));
      move_T.Add((Transform.Translation(board_thickness, 2 * board_thickness, 0)));

      //3 - Back //null
      scale_T.Add((Transform.Scale(Plane.WorldXY, 0, 0, 0)));
      rotate_T.Add(Transform.Rotation(0, Vector3d.YAxis, Point3d.Origin));
      move_T.Add((Transform.Translation(0, 0, 0)));

      //4 - SideLeft
      scale_T.Add((Transform.Scale(Plane.WorldXY, H - board_thickness, D - board_thickness, board_thickness)));
      rotate_T.Add(Transform.Rotation(3 * Math.PI / 2, Vector3d.YAxis, Point3d.Origin));
      move_T.Add((Transform.Translation(board_thickness, board_thickness, 0)));

      //5 - SideRight
      scale_T.Add((Transform.Scale(Plane.WorldXY, -(H - board_thickness), D - board_thickness, board_thickness)));
      rotate_T.Add(Transform.Rotation(Math.PI / 2, Vector3d.YAxis, Point3d.Origin));
      move_T.Add((Transform.Translation(L - board_thickness, board_thickness, 0)));

    }


    for (int i = 0; i < scale_T.Count; i++)
    {
      BoundingBox d = base_box;
      // d.Transform(scale_T[i]);
      // d.Transform(rotate_T[i]);
      // d.Transform(move_T[i]);
      Transform t = move_T[i] * rotate_T[i] * scale_T[i];
      d.Transform(t);
      b.Add(d);
      //*scale_T[0]);
    }

    return b;
  }
# ---------- end carcass_outer ----------
carcass_column = CSharpScript(
    reset=bool_3,
    L=carcass_length_4,
    D=carcass_depth_4,
    H=carcass_height_4,
    board_thickness=board_thickness_4,
    skirting_height=skirting_height_4,
    base_placement=shelves_placement_2,
    leg_type=num_6)  # -> out, column_support, front_board; inputs reset: Boolean, L: Double, D: Double, H: Double, board_thickness: Double, skirting_height: Double, base_placement: tree of Point3d, leg_type: Int32
# ---------- carcass_column: C# ----------
    // Component written by Pallavi Ray
    // POST 105
    // August, 2023
    // V0.1
    Component.NickName = "Carcass_Column";
    Component.Description = "Creates an columns for straight unit";
    //Considering that the center boards columns are 2*board_thickness

    if(init || reset)
    {
      init = false;
      column_DT.Clear();
      column_DT.AddRange(update(L, D, H, board_thickness, skirting_height, base_placement, leg_type), path);
    
    }
    
    column_support = column_DT;
# ---------- carcass_column: C# additional code ----------
  public bool init = true;
  public DataTree<BoundingBox> column_DT = new DataTree<BoundingBox>();
  public GH_Path path = new GH_Path(0, 1);//update later to include the path of the unit type
  
  public List<BoundingBox> update(double L, double D, double H, double board_thickness, double skirting_height, DataTree<Point3d> base_placement, int leg_type)
  {

    BoundingBox base_box = new BoundingBox(new Point3d(0, 0, 0), new Point3d(1, 1, 1));
    //Box base_box = new Box(Plane.WorldXY, new Interval(0, 1), new Interval(0, 1), new Interval(0, 1));


    ///////////////////////////////COLUMN SUPPORT///////////////////////////////
    //Set up tree Column Support Transform
    List<Transform> column_list = new List<Transform>();

    for(int i = 0; i < base_placement.BranchCount;i++)
    {
      if(leg_type == 0)
      {
        Transform move = Transform.Translation(base_placement.Branch(i)[0].X, board_thickness, 0);
        column_list.Add(move);
      }
      else
      {
        Transform move = Transform.Translation(base_placement.Branch(i)[0].X, board_thickness, skirting_height);
        column_list.Add(move);
      }

    }


    //Create the column
    //Create the scale transform for one column

    Transform scale_col = new Transform();
    if(leg_type == 0)
    {
      scale_col = Transform.Scale(Plane.WorldXY, H - board_thickness, D - board_thickness, 2 * board_thickness);
    }
    else
    {
      scale_col = Transform.Scale(Plane.WorldXY, H - skirting_height - board_thickness, D - board_thickness, 2 * board_thickness);
    }

    
    //Create the rotate transform for one column
    Transform rotate_col = Transform.Rotation(3 * Math.PI / 2, Vector3d.YAxis, Point3d.Origin);

    //Generate the data tree for the support column
    List<BoundingBox> columns = new List<BoundingBox>();

    //starting from 1 as the first board wont be present
    for(int i = 1; i < base_placement.BranchCount;i++)
    {
      var b = base_box;
      Transform t = column_list[i] * rotate_col * scale_col;
      b.Transform(t);
      columns.Add(b);

    }


    return columns;
  }
# ---------- end carcass_column ----------
carcass_shelves = CSharpScript(
    reset=bool_4,
    L=carcass_length_5,
    D=carcass_depth_5,
    H=carcass_height_5,
    board_thickness=board_thickness_5,
    skirting_height=skirting_height_5,
    base_placement=shelves_placement_3,
    leg_type=num_7)  # -> out, base_board; inputs reset: Boolean, L: Double, D: Double, H: Double, board_thickness: Double, skirting_height: Double, base_placement: tree of Point3d, leg_type: Int32
# ---------- carcass_shelves: C# ----------
    // Component written by Pallavi Ray
    // POST 105
    // August, 2023
    // V0.1
    Component.NickName = "Carcass_Shelves";
    Component.Description = "Creates an inner carcass for straight unit";
    //Considering that the center boards columns are 2*board_thickness


    if(init || reset)
    {

      shelves_ = update(L, D, H, board_thickness, skirting_height, base_placement, leg_type);

    }

    base_board = shelves_;
# ---------- carcass_shelves: C# additional code ----------
  public bool init = true;
  public DataTree<BoundingBox> shelves_ = new DataTree<BoundingBox>();

  public DataTree<BoundingBox> update(double L, double D, double H, double board_thickness, double skirting_height, DataTree<Point3d> base_placement, int leg_type)
  {

    BoundingBox base_box = new BoundingBox(new Point3d(0, 0, 0), new Point3d(1, 1, 1));
    //Box base_box = new Box(Plane.WorldXY, new Interval(0, 1), new Interval(0, 1), new Interval(0, 1));


    ///////////////////////////////SHELVES///////////////////////////////
    //Set up tree Base Shelves Transform
    DataTree<Transform> shelves_T = new DataTree<Transform>();

    for(int i = 0; i < base_placement.BranchCount;i++)
    {
      GH_Path pth = new GH_Path(i);

      for (int j = 0; j < base_placement.Branch(i).Count;j++)
      {

        Transform move = new Transform(0);

        if(leg_type == 1 && j == 0)
        {}else
        {
          move = Transform.Translation(base_placement.Branch(i)[j].X,
            base_placement.Branch(i)[j].Y + board_thickness,
            base_placement.Branch(i)[j].Z);

        }
        shelves_T.Add(move, pth);
      }
    }


    //Create the shelves
    //Create the scale transform for one shelf
    double num_col = base_placement.BranchCount;

    Transform scale = Transform.Scale(Plane.WorldXY,
      (L - (2 * num_col * board_thickness)) / num_col,
      D - board_thickness,
      -board_thickness);


    DataTree<BoundingBox> shelves = new DataTree<BoundingBox>();

    for(int i = 0; i < base_placement.BranchCount;i++)
    {
      GH_Path pth = new GH_Path(0,0, i);
      for (int j = 0; j < base_placement.Branch(i).Count;j++)

      {
        BoundingBox b = new BoundingBox(new Point3d(0, 0, 0), new Point3d(0, 0, 0));

        if(leg_type != 0 && j == 0)
        {}else
        {
          //BoundingBox rc;

          b = base_box;
          Transform t = shelves_T.Branch(i)[j] * scale;
          b.Transform(t);

        }
        shelves.Add(b, pth);
      }
    }


    return shelves;
  }
# ---------- end carcass_shelves ----------
column_support = Brep(carcass_column.column_support)

outercarcass_geo = Data(carcass_outer.outerCarcass)
base_board = Geometry(carcass_shelves.base_board)
list_item_2 = ListItem(List=reverse(base_board), Index=0, Wrap=True)
leg_type_5 = Data(leg_type)
item = ListItem(List=outercarcass_geo, Index=0, Wrap=True)
item_2 = ListItem(List=outercarcass_geo, Index=1, Wrap=True)
item_3 = ListItem(List=outercarcass_geo, Index=2, Wrap=True)
item_4 = ListItem(List=outercarcass_geo, Index=3, Wrap=True)
item_5 = ListItem(List=outercarcass_geo, Index=4, Wrap=True)
item_6 = ListItem(List=outercarcass_geo, Index=5, Wrap=True)
panel_22 = Panel(column_support)
panel_23 = Panel(list_item_2)
side0_geometry = Brep(item_5)
side1_geometry = Brep(item_6)
top_geometry = Brep(item)
base = Brep(item_2)
shift_paths_2 = ShiftPaths(Data=replace_paths, Offset=-1)
shift_paths_3 = ShiftPaths(Data=shelves_sizing_vector3d, Offset=-1)
panel_24 = Panel("""This component 
- finds which shelves correspond to the type "Shutter"

-  creates a separate dataTree of the position and sizes which correspond to this shelf type 

- consider if continuous shutthers in one column then continuous shutter""")
bool_5 = Boolean(bool)
board_thickness_6 = Data(board_thickness)
shelves_placement_point3d_2 = Data(simplify(shift_paths))
shelves_sizing_double = Data(simplify(shift_paths_3))
boxselectionlist = Data(shift_paths_2)
panel_25 = Panel("""This component 
- finds which shelves correspond to the type "Shutter"

-  creates a separate dataTree of the position and sizes which correspond to this shelf type """)
continuous_shutter = CSharpScript(
    description=panel_24,
    reset=bool_5,
    boardThickness=board_thickness_6,
    placement=shelves_placement_point3d_2,
    sizing=shelves_sizing_double,
    boxSelectionList=boxselectionlist,
    type="Shutter")  # -> out, shelfPlacement_updated, shelfSizing_List, A; inputs reset: Boolean, boardThickness: Double, placement: tree, sizing: tree, boxSelectionList: tree, type: String
# ---------- continuous_shutter: C# usings ----------
using System.IO;
using System.Linq;
using System.Data;
using System.Drawing;
using System.Reflection;
using System.Windows.Forms;
using System.Xml;
using System.Xml.Linq;
using System.Runtime.InteropServices;

using Rhino.DocObjects;
using Rhino.Collections;
using GH_IO;
using GH_IO.Serialization;
# ---------- continuous_shutter: C# ----------
    // Component written by Pallavi Ray
    // POST 105
    // Sept, 2023
    // V0.1
    Component.NickName = "Continuous Shutter";
    Component.Description = "Checks for conitunous shutter";

    if(init || reset)
    {

      slf = new Shelves(_placement, _sizing, _boxSelectionList, _type, boardThickness);
      init = false;
    }


    //    if(reset)
    //    {
    //      slf.UpdateShelf();
    //    }

    shelfPlacement_updated = slf.placement_List;
    shelfSizing_List = slf.size_List;
    A = slf.streak_List;
# ---------- continuous_shutter: C# additional code ----------
  //gloabal variables
  public Shelves slf;
  public bool init = true;

  //shelves class
  public class Shelves
  {
    //properties
    public DataTree<object> placement_List;
    public DataTree<object> size_List;
    public DataTree<int> streak_List;


    //constructor
    public Shelves(DataTree < object > placement, DataTree < object > sizing, DataTree < object > DataboxSelectionList, string type, double boardThickness)
    {
      //Declare a tree of spheres
      this.placement_List = new DataTree<object>();
      this.size_List = new DataTree<object>();
      this.streak_List = new DataTree<int> ();

      int pathIndex = 0;

      //each column
      foreach (List<object> branch in DataboxSelectionList.Branches)
      {
        List<object> pL = new List<object>();
        List<object> sL = new List<object>();
        int [] streakList = new int[DataboxSelectionList.Branch(pathIndex).Count];


        //check each row
        GH_Path path = new GH_Path(pathIndex);


        int streak = 0;


        for (int i = DataboxSelectionList.Branch(pathIndex).Count - 1; i > -1; i--)
        {
          streakList[i] = 0;

          if(DataboxSelectionList.Branch(pathIndex)[i].ToString() == type)
          {
            streak += 1;
          }
          else
          {
            if( i < DataboxSelectionList.Branch(pathIndex).Count - 1 )
              streakList[i + 1] = streak;

            streak = 0;
          }

          streakList[0] = streak;

        }



        //assign the size
        for (int i = 0; i < DataboxSelectionList.Branch(pathIndex).Count; i++)
        {

          if(streakList[i] == 0)
          {
            pL.Add(null);
            sL.Add(null);
          }
          else
          {
            //cast object to point3d and vector3d
            Point3d position = (Rhino.Geometry.Point3d) placement.Branch(path)[i];
            Vector3d size = (Rhino.Geometry.Vector3d) sizing.Branch(path)[i];

            pL.Add(position);
            sL.Add(new Vector3d(size.X, size.Y, size.Z * streakList[i] + (boardThickness * (streakList[i] - 1))));

          }
        }

        this.placement_List.AddRange(pL, path);
        this.size_List.AddRange(sL, path);
        this.streak_List.AddRange(streakList, path);

        pathIndex = pathIndex + 1;

      }

    }
  }
# ---------- end continuous_shutter ----------
shelfplacement_list = Data(continuous_shutter.shelfPlacement_updated)
shelves_sizing_updated = Data(continuous_shutter.shelfSizing_List)
panel_26 = Panel(shelves_sizing_updated)
panel_27 = Panel("copy from above")

# ---- group: flushed
# This component
# generated meshes for flushed fascia
shelfsizing_list = Data(shelves_sizing_updated)
board_thickness_7 = Data(board_thickness)
flushedshutter_mesh = CSharpScript(size=shelfsizing_list, board_thickness=board_thickness_7)  # -> out, A; inputs size: tree, board_thickness: Double
# ---------- flushedshutter_mesh: C# ----------
    ///////////////////////////////SHUTTER///////////////////////////////
    //Set up tree Shutter Brep
    DataTree<Mesh> shutter_flushed = new DataTree<Mesh>();

    for(int i = 0; i < _size.BranchCount;i++)
    {
      GH_Path pth = new GH_Path(i);

      for (int j = 0; j < _size.Branch(i).Count;j++)
      {

        Mesh geo = null;


        if (_size.Branch(i)[j] != null && _size.Branch(i)[j] is Vector3d)
        {

          Vector3d p = new Vector3d((Vector3d) _size.Branch(i)[j]);
          geo = drawShutterFlused(p, board_thickness);

        }


        shutter_flushed.Add(geo, pth);

      }
    }

    A = shutter_flushed;
# ---------- flushedshutter_mesh: C# additional code ----------
  //function to generate the mesh
  public Mesh drawShutterFlused(Vector3d size, double _board_thickness)
  {

    Mesh geo_ = new Mesh();

    //vertices
    for (double i = -_board_thickness + 2 ; i <= size.X + _board_thickness+2 ; i += size.X + 2 * _board_thickness - 4)
    {
      for (double j = 0; j <= _board_thickness; j += _board_thickness)
      {
        for (double k = -_board_thickness+2; k <= size.Z; k += size.Z + _board_thickness-4)
        {
          geo_.Vertices.Add(new Point3d(i, j, k));
        }
      }
    }

    //faces
    geo_.Faces.AddFace(0, 1, 5, 4);
    geo_.Faces.AddFace(0, 4, 6, 2);
    geo_.Faces.AddFace(0, 2, 3, 1);
    geo_.Faces.AddFace(7, 3, 2, 6);
    geo_.Faces.AddFace(7, 6, 4, 5);
    geo_.Faces.AddFace(7, 5, 1, 3);

    geo_.FaceNormals.ComputeFaceNormals();
    geo_.Normals.ComputeNormals();
    geo_.Compact();

    return geo_;

  }
# ---------- end flushedshutter_mesh ----------

# ---- group: flutted
board_thickness_8 = Data(board_thickness)
shelfsizing_list_2 = Data(shelves_sizing_updated)
fluttedshutter = FluttedShutter_(Y=board_thickness_8, L=shelfsizing_list_2)

# ----
board_thickness_9 = Data(board_thickness)

# ---- group: panelled
board_thickness_10 = Data(board_thickness)
shelfsizing_list_3 = Data(shelves_sizing_updated)
panelledshutter = PanelledShutter_(board_thickness=board_thickness_10, V=shelfsizing_list_3)

# ---- group: glass
# This component
# generated meshes for glass fascia
shelfsizing_list_4 = Data(shelves_sizing_updated)
glass_thickness = Panel("5")
flushedshutter_mesh_2 = CSharpScript(size=shelfsizing_list_4, board_thickness=board_thickness_9, glass_thickness=glass_thickness)  # -> out, A; inputs size: tree, board_thickness: Double, glass_thickness: Double
# ---------- flushedshutter_mesh_2: C# ----------
    ///////////////////////////////SHUTTER///////////////////////////////
    //Set up tree Shutter Brep
    DataTree<Mesh> shutter_flushed = new DataTree<Mesh>();

    for(int i = 0; i < _size.BranchCount;i++)
    {
      GH_Path pth = new GH_Path(i);

      for (int j = 0; j < _size.Branch(i).Count;j++)
      {

        Mesh geo = null;


        if (_size.Branch(i)[j] != null && _size.Branch(i)[j] is Vector3d)
        {

          Vector3d p = new Vector3d((Vector3d) _size.Branch(i)[j]);
          geo = drawShutterFlused(p, board_thickness, glass_thickness);

        }


        shutter_flushed.Add(geo, pth);

      }
    }

    A = shutter_flushed;
# ---------- flushedshutter_mesh_2: C# additional code ----------
  //function to generate the mesh
  public Mesh drawShutterFlused(Vector3d size, double _board_thickness, double _glass_thickness)
  {

    Mesh geo_ = new Mesh();

    //vertices
    for (double i = -_board_thickness + 2 ; i <= size.X + _board_thickness + 2 ; i += size.X + 2 * _board_thickness - 4)
    {
      for (double j = 0; j <= _glass_thickness; j += _glass_thickness)
      {
        for (double k = -_board_thickness + 2; k <= size.Z; k += size.Z + _board_thickness - 4)
        {
          geo_.Vertices.Add(new Point3d(i, j, k));
        }
      }
    }

    //faces
    geo_.Faces.AddFace(0, 1, 5, 4);
    geo_.Faces.AddFace(0, 4, 6, 2);
    geo_.Faces.AddFace(0, 2, 3, 1);
    geo_.Faces.AddFace(7, 3, 2, 6);
    geo_.Faces.AddFace(7, 6, 4, 5);
    geo_.Faces.AddFace(7, 5, 1, 3);

    geo_.FaceNormals.ComputeFaceNormals();
    geo_.Normals.ComputeNormals();
    geo_.Compact();

    return geo_;

  }
# ---------- end flushedshutter_mesh_2 ----------

# ----
shutter_type_2 = Data(shutter_type)
brep = Brep(fluttedshutter)
brep_2 = Brep(panelledshutter)
filter = StreamFilter(Gate=shutter_type_2, Stream0=flushedshutter_mesh.A, Stream1=brep, Stream2=flushedshutter_mesh_2.A, Stream3=brep_2)

panel_28 = Panel("Mesh")
panel_29 = Panel("Brep")
shelfplacement_list_2 = Data(shelfplacement_list)
move_2 = Move(Geometry=filter, Motion=shelfplacement_list_2)  # -> Geometry, Transform

# ----
# SHUTTER
shutter_fascia = Data(move_2.Geometry)

# ---- group: shutter_handle
shelfsizing_tree = Data(shelves_sizing_updated)
shelfplacement_tree = Data(shelfplacement_list)
knob_handle_2 = Data(knob_handle)
cluster = Cluster(shutter_drawer="0", knob_handle_geo=knob_handle_2, shelf_sizing=shelfsizing_tree, shelf_placement=shelfplacement_tree)
shutter_handle = Data(cluster)

# ----
top_geometry_2 = Brep(top_geometry)
side1_geometry_2 = Brep(side1_geometry)
shutter = Data(shutter_fascia)
shutter_handle_2 = Data(shutter_handle)
side0_geometry_2 = Brep(side0_geometry)
base_2 = Brep(base)
column_support_2 = Brep(column_support)
brep_3 = Brep(list_item_2)

# ----
# Leg
carcass_length_6 = Data(datadam_trigger.OutData)
carcass_depth_6 = Data(carcass_depth)
rectangle = Rectangle(Plane=PlaneXY(0, 0, 0), XSize=carcass_length_6, YSize=carcass_depth_6, Radius=0)  # -> Rectangle, Length
offset = OffsetCurve(Curve=rectangle.Rectangle, Distance="-100", Corners=1)
explode = Explode(Curve=offset, Recursive=True)  # -> Segments, Vertices
cullpt = CullDuplicates(Points=explode.Vertices, Tolerance=0.1, CullMode=3)  # -> Points, Indices, Valence
skirting_height_6 = Data(skirting_height)
board_thickness_11 = Data(board_thickness)

rounded_leg = Rounded_leg(T=cullpt.Points, A=skirting_height_6, B=board_thickness_11)

leg_2 = Data(rounded_leg)
filter_2 = StreamFilter(Gate=leg_type_5, Stream1=leg_2, Stream2=leg_2)
leg_3 = Data(filter_2)

leg_4 = Data(leg_3)
merge = Merge(
    Data1=flatten(top_geometry_2),
    Data2=flatten(side0_geometry_2),
    Data3=flatten(side1_geometry_2),
    Data4=flatten(base_2),
    Data5=flatten(column_support_2),
    Data6=flatten(leg_4),
    Data7=brep_3)

# ----
# DRAWER
bool_6 = Boolean(bool)
shelves_placement_point3d_3 = Data(simplify(shift_paths))
shelves_sizing_double_2 = Data(simplify(shift_paths_3))
boxselectionlist_2 = Data(simplify(shift_paths_2))
shelf_sorter = CSharpScript(
    description=panel_25,
    reset=bool_6,
    placement=shelves_placement_point3d_3,
    sizing=shelves_sizing_double_2,
    boxSelectionList=boxselectionlist_2,
    type="Drawer")  # -> out, shelfPlacement_List, shelfSizing_List; inputs reset: Boolean, placement: tree, sizing: tree, boxSelectionList: tree, type: String
# ---------- shelf_sorter: C# ----------
    // Component written by Pallavi Ray
    // POST 105
    // June, 2023
    // V0.1
    Component.NickName = "Shelf Sorter";
    Component.Description = "Selects the type of drawer and the details of heights";

    if(init || reset)
    {

      //      if((numOfBox != typesOfBox.Count()) || (numOfBox != heightsOfBox.Count()) || (heightsOfBox.Count != typesOfBox.Count))
      //      {
      //        Print("ERROR: Match the number of boxes to number of types");
      //      }
      //
      slf = new Shelves(_placement, _sizing, _boxSelectionList, _type);
      init = false;
    }


    //    if(reset)
    //    {
    //      slf.UpdateShelf();
    //    }

    shelfPlacement_List = slf.placement_List;
    shelfSizing_List = slf.size_List;
# ---------- shelf_sorter: C# additional code ----------
  public Shelves slf;
  public bool init = true;

  public class Shelves
  {
    public DataTree<object> placement_List;
    public DataTree<object> size_List;


    //
    public Shelves(DataTree < object > placement, DataTree < object > sizing, DataTree < object > DataboxSelectionList, string type)
    {
      //Declare a tree of spheres
      this.placement_List = new DataTree<object>();
      this.size_List = new DataTree<object>();


      int pathIndex = 0;
      foreach (List<object> branch in DataboxSelectionList.Branches)
      {
        List<object> pL = new List<object>();
        List<object> sL = new List<object>();

        GH_Path path = new GH_Path(pathIndex);
        pathIndex = pathIndex + 1;

        for (int i = 0; i < DataboxSelectionList.Branch(pathIndex - 1).Count; i++)
        {

          if(DataboxSelectionList.Branch(pathIndex - 1)[i].ToString() == type)
          {
            pL.Add(placement.Branch(path)[i]);
            sL.Add(sizing.Branch(path)[i]);
          }
          else
          {
            pL.Add(null);
            sL.Add(null);
          }
        }
        this.placement_List.AddRange(pL, path);
        this.size_List.AddRange(sL, path);
      }


    }


  }
# ---------- end shelf_sorter ----------

panel_35 = Panel(shelf_sorter.shelfSizing_List)

shelfsizing_list_5 = Data(shelf_sorter.shelfSizing_List)
board_thickness_12 = Data(board_thickness)
flushedshutter_mesh_3 = CSharpScript(size=shelfsizing_list_5, board_thickness=board_thickness_12)  # -> out, A; inputs size: tree, board_thickness: Double; same code as flushedshutter_mesh

# ---- group: drawer_fascia
board_thickness_13 = Data(board_thickness)
# As there cant be glass fascia to drawer the flushed is copied to drawer in case of glass option
shelfsizing_list_6 = Data(shelf_sorter.shelfSizing_List)
fluttedshutter_2 = FluttedShutter_(Y=board_thickness_13, L=shelfsizing_list_6)

board_thickness_14 = Data(board_thickness)
shelfsizing_list_7 = Data(shelf_sorter.shelfSizing_List)
panelledshutter_2 = PanelledShutter_(board_thickness=board_thickness_14, V=shelfsizing_list_7)

# ---- group: drawer_box
shelfsizing_list_8 = Data(shelf_sorter.shelfSizing_List)
board_thickness_15 = Data(board_thickness)
bottom_clearance_2 = Data(bottom_clearance)
channel_clearance_2 = Data(channel_clearance)
# this component generates all the side/box geometries for the drawer except the fascia. ie the bottom, back and sides
pln_2 = Plane(vec.Vector)
drawer = CSharpScript(
    base=pln_2,
    size=shelfsizing_list_8,
    board_thickness=board_thickness_15,
    top_clearance=board_thickness_15,
    bottom_clearance=bottom_clearance_2,
    channel_clearance=channel_clearance_2)  # -> out, A; inputs base: Plane, size: tree, board_thickness: Double, top_clearance: Double, bottom_clearance: Double, channel_clearance: Double
# ---------- drawer: C# ----------
    // Component written by Pallavi Ray
    // POST 105
    // August, 2023
    // V0.1
    Component.NickName = "drawer";
    Component.Description = "Creates an drawer for shelve unit";

    ///////////////////////////////DRAWER///////////////////////////////
    //Set up tree Drawer

    DataTree<BoundingBox> drawer = new DataTree<BoundingBox>();

    for(int i = 0; i < _size.BranchCount;i++)
    {


      for (int j = 0; j < _size.Branch(i).Count;j++)
      {
        GH_Path path = new GH_Path(i, j);

        List<BoundingBox> eachDrawer = new List<BoundingBox>();


        if (_size.Branch(i)[j] != null && _size.Branch(i)[j] is Vector3d)
        {

          Vector3d p = new Vector3d((Vector3d) _size.Branch(i)[j]);
          eachDrawer = drawDrawer(p, board_thickness, top_clearance, bottom_clearance, channel_clearance);
        }

        drawer.AddRange(eachDrawer, path);

      }
    }

    A = drawer;
# ---------- drawer: C# additional code ----------
  public List<BoundingBox> drawDrawer(Vector3d size, double board_thickness, double top_clearance, double bottom_clearance, double channel_clearance)
  {

    BoundingBox base_box = new BoundingBox(new Point3d(0, 0, 0), new Point3d(1, 1, 1));
    //Box base_box = new Box(Plane.WorldXY, new Interval(0, 1), new Interval(0, 1), new Interval(0, 1));

    List<Transform> scale_T = new List<Transform>();
    List<Transform> rotate_T = new List<Transform>();
    List<Transform> move_T = new List<Transform>();


    //Creating Planes
    var origin = Point3d.Origin;

    //assign the size
    double L = size.X;
    double D = size.Y;
    double H = size.Z;

    //    //0 - Front
    //    scale_T.Add((Transform.Scale(Plane.WorldXY, L - (2 * board_thickness), H, board_thickness)));
    //    rotate_T.Add(Transform.Rotation(Math.PI / 2, Vector3d.XAxis, Point3d.Origin));
    //    move_T.Add((Transform.Translation(board_thickness, 2 * board_thickness, 0)));

    //1 - Base
    scale_T.Add((Transform.Scale(Plane.WorldXY, L - 2 * (board_thickness + channel_clearance), D - board_thickness, board_thickness)));
    rotate_T.Add(Transform.Rotation(0, Point3d.Origin));
    move_T.Add((Transform.Translation(board_thickness + channel_clearance, board_thickness, bottom_clearance)));

        
    //3 - Back
    scale_T.Add((Transform.Scale(Plane.WorldXY, L - 2 * (board_thickness + channel_clearance), H - board_thickness - bottom_clearance - top_clearance, board_thickness)));
    rotate_T.Add(Transform.Rotation(Math.PI / 2, Vector3d.XAxis, Point3d.Origin));
    move_T.Add((Transform.Translation(board_thickness + channel_clearance, D - board_thickness, bottom_clearance + board_thickness)));

   
    //4 - Side0
    scale_T.Add((Transform.Scale(Plane.WorldXY, H - bottom_clearance - top_clearance, D - board_thickness, board_thickness)));
    rotate_T.Add(Transform.Rotation(3 * Math.PI / 2, Vector3d.YAxis, Point3d.Origin));
    move_T.Add((Transform.Translation(board_thickness + channel_clearance, board_thickness, bottom_clearance)));

    //5 - Side1
    scale_T.Add((Transform.Scale(Plane.WorldXY, -(H - (bottom_clearance + top_clearance)), D - board_thickness, board_thickness)));
    rotate_T.Add(Transform.Rotation(Math.PI / 2, Vector3d.YAxis, Point3d.Origin));
    move_T.Add((Transform.Translation(L - board_thickness - channel_clearance, board_thickness, bottom_clearance)));

   

    List<BoundingBox> listOfSides = new List<BoundingBox> ();

    for (int i = 0; i < scale_T.Count; i++)
    {
      var b = base_box;
      // d.Transform(scale_T[i]);
      // d.Transform(rotate_T[i]);
      // d.Transform(move_T[i]);
      Transform t = move_T[i] * rotate_T[i] * scale_T[i];
      b.Transform(t);
      listOfSides.Add(b);
      //*scale_T[0]);
    }

    return listOfSides;

  }
# ---------- end drawer ----------
shelfplacement_list_3 = Data(graft(shelf_sorter.shelfPlacement_List))
drawer_geometry = Brep(drawer.A)
move_3 = Move(Geometry=drawer_geometry, Motion=shelfplacement_list_3)  # -> Geometry, Transform
drawer_geo = Data(move_3.Geometry)

# ---- group: drawer_fascia
shutter_type_3 = Data(shutter_type)
brep_4 = Brep(fluttedshutter_2)
brep_5 = Brep(panelledshutter_2)
filter_3 = StreamFilter(Gate=shutter_type_3, Stream0=flushedshutter_mesh_3.A, Stream1=brep_4, Stream2=flushedshutter_mesh_3.A, Stream3=brep_5)
move_4 = Move(Geometry=filter_3, Motion=shelf_sorter.shelfPlacement_List)  # -> Geometry, Transform
drawer_fascia = Data(graft(move_4.Geometry))

# ----
merge_2 = Merge(Data1=drawer_fascia, Data2=drawer_geo)
drawer_geo_2 = Data(merge_2)

# ---- group: drawer_handle
shelfplacement_tree_2 = Data(shelf_sorter.shelfPlacement_List)
knob_handle_3 = Data(knob_handle)
shelfsizing_tree_2 = Data(shelf_sorter.shelfSizing_List)
addition = Addition(A=shelfplacement_tree_2)
cluster_2 = Cluster(shutter_drawer="1", knob_handle_geo=knob_handle_3, shelf_sizing=shelfsizing_tree_2, shelf_placement=addition)
drawer_handle = Data(cluster_2)

# ----
drawer_handle_2 = Data(drawer_handle)
drawer_geo_3 = Data(drawer_geo_2)
merge_3 = Merge(Data1=flatten(shutter_handle_2), Data2=flatten(drawer_handle_2))
merge_4 = Merge(Data1=flatten(shutter), Data2=flatten(drawer_geo_3))
geo = Geometry([merge, merge_4, merge_3])
mesh = MeshBrep(
    Brep=geo,
    Settings={GridMaxCount=0, GridMinCount=16, JaggedSeams=False, MaxEdgeLength=0, MinEdgeLength=0.0001, MinTolerance=0, Refine=True, RefineAngle=0, RelativeTolerance=0.65, SimplePlanes=True, Tolerance=0})
mjoin = MeshJoin(Meshes=mesh)

# ---- group: RH_OUT:mesh
mesh_2 = Mesh(mjoin)

# ==== cluster PanelledShutter_
board_thickness = ClusterInput()
V = ClusterInput()
xz = XZPlane(Origin=Point(0, 0, 0))
devec = DeconstructVector(Vector=V)  # -> XComponent, YComponent, ZComponent
x_2 = Number(expr("x -2", board_thickness))
x_2_2 = Number(expr("-x + 2", board_thickness))
addition = Addition(A=devec.XComponent, B=x_2)
x_2_3 = Number(expr("-x + 2", board_thickness))
addition_2 = Addition(A=devec.ZComponent, B="-2")
dom = ConstructDomain(DomainStart=x_2_2, DomainEnd=addition)
dom_2 = ConstructDomain(DomainStart=x_2_3, DomainEnd=addition_2)
rectangle = Rectangle(Plane=xz, XSize=dom, YSize=dom_2, Radius=0)  # -> Rectangle, Length
Y = UnitY(Factor=board_thickness)
clean = CleanTree(RemoveNulls=True, RemoveInvalid=True, RemoveEmpty=False, Tree=rectangle.Rectangle)
offset = OffsetCurve(Curve=rectangle.Rectangle, Distance="-50", Plane=xz, Corners=1)
pipe = Pipe(Curve=offset, Radius="5", Caps=0)
extr = Extrude(Base=rectangle.Rectangle, Direction=Y)
cap = CapHoles(Brep=extr)  # -> graft(Brep)
shift = ShiftPaths(Data=pipe, Offset=-1)
panel = Panel(shift)
panel_2 = Panel(cap)
sunion = SolidUnion(Breps=[cap, shift])
shift_2 = ShiftPaths(Data=sunion, Offset=-1)
D = ClusterOutput(shift_2)

# ==== cluster FluttedShutter_
Y = ClusterInput()
L = ClusterInput()
null = NullItem(Item=L)  # -> NullFlags, InvalidFlags, Description
cull = CullPattern(List=L, CullPattern=invert(null.NullFlags))
clean = CleanTree(RemoveNulls=True, RemoveInvalid=True, RemoveEmpty=False, Tree=cull)
prune = PruneTree(Tree=clean, Minimum=1, Maximum=0)
x_2 = Number(expr("-x + 2", Y))
x_2_2 = Number(expr("x -2", Y))
devec = DeconstructVector(Vector=prune)  # -> XComponent, YComponent, ZComponent
addition = Addition(A=devec.XComponent, B=x_2_2)
dom = ConstructDomain(DomainStart=x_2, DomainEnd=addition)
vec = VectorXYZ(XComponent=x_2, YComponent=0, ZComponent=0)  # -> Vector, Length
vec_2 = VectorXYZ(XComponent=addition, YComponent=0, ZComponent=0)  # -> Vector, Length
xy = XYPlane(Origin=Point(0, 0, 0))
X = UnitX(Factor=1)
ln = Line(StartPoint=vec.Vector, EndPoint=vec_2.Vector)
rectangle = Rectangle(Plane=xy, XSize=dom, YSize=Y, Radius=0)  # -> Rectangle, Length
line = LineSDL(Start=vec.Vector, Direction=X, Length=ln)
divlength = DivideLength(Curve=line, Length="10")  # -> Points, Tangents, Parameters
num = Number(expr("x/2", "10"))
Y_2 = UnitY(Factor=num)
arc = Arc(Plane=divlength.Points, Radius=expr("x/2", "10"), Angle=Domain(0, -3.141592654))  # -> Arc, Length
join = JoinCurves(Curves=arc.Arc, Preserve=False)  # -> simplify(Curves)
move = Move(Geometry=join, Motion=Y_2)  # -> Geometry, Transform
shift = ShiftPaths(Data=move.Geometry, Offset=-1)
srfsplit = SurfaceSplit(Surface=rectangle.Rectangle, Curves=shift)
item = ListItem(List=reverse(srfsplit), Index=0, Wrap=True)
x_4 = Number(expr("x -4", Y))
addition_2 = Addition(A=devec.ZComponent, B=x_4)
Z = UnitZ(Factor=addition_2)
extr = Extrude(Base=item, Direction=Z)
x_2_3 = Number(expr("-x + 2", Y))
Z_2 = UnitZ(Factor=x_2_3)
move_2 = Move(Geometry=extr, Motion=Z_2)  # -> Geometry, Transform
shift_2 = ShiftPaths(Data=move_2.Geometry, Offset=-1)  # -> flatten(Data)
match_dt = CSharpScript(list=shift_2, to_match=L)  # -> A; inputs list: list, to_match: tree
# ---------- match_dt: C# ----------
    ///////////////////////////////DataTree///////////////////////////////
    //Set up tree
    DataTree<object> new_dt = new DataTree<object>();
         int c = 0;

    for(int i = 0; i < to_match.BranchCount;i++)
    {
      GH_Path path = new GH_Path(i);
 

      for (int j = 0; j < to_match.Branch(i).Count;j++)
      {

        System.Object obj = null;


        if (to_match.Branch(i)[j] != null)
        {

          obj = list[c];
          c++;

        }


        new_dt.Add(obj, path);

      }
    }

    A = new_dt;
# ---------- end match_dt ----------
panel = Panel(match_dt)
A = ClusterOutput(match_dt)

# ==== cluster Rounded_leg
A = ClusterInput()
B = ClusterInput()
subtraction = Subtraction(A=A, B=B)
cir = Circle(Plane=PlaneXY(0, 0, 0), Radius="10")
Z = UnitZ(Factor=subtraction)
extr = Extrude(Base=cir, Direction=Z)
vec = VectorXYZ(XComponent=0, YComponent=0, ZComponent=0)  # -> Vector, Length
T = ClusterInput()
cap = CapHoles(Brep=extr)
move = Move(Geometry=cap, Motion=T)  # -> Geometry, Transform
G = ClusterOutput(move.Geometry)

# ==== cluster Cluster
shutter_drawer = ClusterInput()
knob_handle_geo = ClusterInput()
shelf_sizing = ClusterInput()
shelf_placement = ClusterInput()
rotation_transform = ClusterInput()
null = NullItem(Item=shelf_sizing)  # -> NullFlags, InvalidFlags, Description
cull = CullPattern(List=shelf_sizing, CullPattern=invert(null.NullFlags))
clean = CleanTree(RemoveNulls=True, RemoveInvalid=True, RemoveEmpty=False, Tree=cull)
prune = PruneTree(Tree=clean, Minimum=1, Maximum=0)
devec = DeconstructVector(Vector=prune)  # -> XComponent, YComponent, ZComponent
subtraction = Subtraction(A=devec.ZComponent, B="100")
num = Number(expr("x/2", devec.XComponent))
filter = StreamFilter(Gate=shutter_drawer, Stream0="70", Stream1=num)
filter_2 = StreamFilter(Gate=shutter_drawer, Stream0="0", Stream1="pi*0.5")
xz = XZPlane(Origin=Point(0, 0, 0))
vec = VectorXYZ(XComponent=filter, YComponent=0, ZComponent=subtraction)  # -> Vector, Length
vec_2 = VectorXYZ(XComponent=filter, YComponent=0, ZComponent=subtraction)  # -> Vector, Length
rotate = Rotate(Geometry=knob_handle_geo, Angle=filter_2, Plane=xz)  # -> Geometry, Transform
filter_3 = StreamFilter(Gate=shutter_drawer, Stream0=vec.Vector, Stream1=vec_2.Vector)
placement = Data(filter_3)
move = Move(Geometry=rotate.Geometry, Motion=placement)  # -> Geometry, Transform
match_dt = CSharpScript(list=flatten(move.Geometry), to_match=shelf_sizing)  # -> A; inputs list: list, to_match: tree; same code as match_dt
transform = Transform(Geometry=match_dt, Transform=rotation_transform)
filter_4 = StreamFilter(Gate=shutter_drawer, Stream0=transform, Stream1=match_dt)
move_2 = Move(Geometry=filter_4, Motion=shelf_placement)  # -> Geometry, Transform
G = ClusterOutput(move_2.Geometry)
